# Grasshopper definition vizualize.ghx (Grasshopper 1.0.7)

number_slider = Slider(100, range=1..100)
# cumulative reachability
list = ValueList({"Output1": "output_data.json", "Robot 2": "rob2", "Robot 3": "rob3", "Robot 1&2": "rob1,rob2", "Robot 1&3": "rob1,rob3", "Robot 2&3": "rob2,rob3", "Robot 1&2&3": "rob1,rob2,rob3"}, selected="Output1")

data = Data("/Users/edvard/Documents/github/scaffree_3dec/3dec_output")
data_2 = Data(list)
data_3 = Data()
python = GhPythonScript(path=data, file_name=data_2, step_num=data_3, read_data=Toggle(True))  # -> points, lengths, max_length, simplify(vectors); inputs step_num: Int32
# ---------- python: Python ----------
import os
import json
from compas.geometry import Vector

import rhinoscriptsyntax as rs

if read_data:
    
    filepath = os.path.join(path, file_name)

    with open(filepath, "r") as f:
        file_data = f.read()
        data = json.loads(file_data)
        f.close()
    
    points = []
    lengths = []
    max_length = 0
    max_length_index = 0
    for key, value in data["model_blocks"].items():
        points.append(rs.CreatePoint(value["position"]))
        
        k = key
        v = value["f_unbalance"]
        vec = Vector(v[0],v[1],v[2])
        
        lengths.append(vec.length)
        
        if vec.length > max_length:
            max_length = vec.length
            max_length_index = key
            
        
        
    print k, vec.length
    print max_length_index, max_length
# ---------- end python ----------
pt = Point(python.points)
num = Number(python.lengths)
num_2 = Number(python.max_length)
division = Division(A=num, B=num_2)
panel = Panel(pt)
panel_2 = Panel(num_2)
int = Integer(num)
gradient = Gradient(
    LowerLimit="0",
    UpperLimit="15",
    Parameter=int,
    stops=[0: RGB(255, 255, 255), 0.1: RGB(236, 27, 60), 0.2: RGB(210, 0, 118), 0.3: RGB(103, 0, 120), 0.4: RGB(39, 72, 161), 0.5: RGB(1, 192, 229), 0.6: RGB(18, 178, 90), 0.7: RGB(79, 186, 8), 0.8: RGB(220, 237, 32), 0.9: RGB(247, 159, 20), 1: RGB(243, 57, 0)])
preview = CustomPreview(Geometry=pt, Material=gradient)
